# Dynamo graph PointsTest.dyn (Dynamo 2.1.1.8252)

code_block = CodeBlock { 0..1000; }
byCoordinates = Point.ByCoordinates(x=code_block, y=code_block)
code_block_2 = CodeBlock { 200; }
translate = Geometry.Translate(geometry=byCoordinates, zTranslation=code_block_2)
